# Grasshopper definition Center_excel.gh (Grasshopper 1.0.8)

point = Point([<point referenced from the Rhino model> x3])
deconstruct = Deconstruct(Point=point)  # -> XComponent, YComponent, ZComponent
panel = Panel(deconstruct.XComponent)
panel_2 = Panel(deconstruct.YComponent)
panel_3 = Panel(deconstruct.ZComponent)
merge = Merge(Data1=graft(deconstruct.XComponent), Data2=graft(deconstruct.YComponent), Data3=graft(deconstruct.ZComponent))
panel_4 = Panel(merge)
